# Grasshopper definition testBrepEnvi.gh (Grasshopper 0.9.76)
# plug-ins: Physarealm

detect_direction_setting = DetectDirectionSetting(DetectDirection=4)
point = Point([<point referenced from the Rhino model> x2])
point_2 = Point([<point referenced from the Rhino model> x5])
box = Box({Plane=Plane(origin=(0, 0, 0), x=(0, 1, 0), y=(1, 0, 0)), X=Domain(0, 100), Y=Domain(0, 100), Z=Domain(-100, 0)})
death_distance_setting = DeathDistanceSetting(DeathDistance=Slider(56, range=0..100))
point_emitter = PointEmitter(Points=point)
trail_setting = TrailSetting(AgentFoodTrailRatio=Slider(0.5, range=0..1))
points_food = PointsFood(Points=point_2)
birth_death_setting = BirthDeathSetting(
    DivisionDetectRadius=Slider(3, range=0..10),
    DivisionMin=0,
    DivisionMax=10,
    DeathDetectRadius=Slider(2, range=0..10),
    DeathMin=0,
    DeathMax=123)
box_environment = BoxEnvironment(XResolution=100, YResolution=100, ZResolution=100, Box=box)
guide_setting = GuideSetting(VerticalGuideFactor=Slider(0.06, range=0..1))
initial_population_setting = InitialPopulationSetting(PopulationSize=200)
speed_setting = SpeedSetting(MaxSpeed=Slider(2, range=0..10))
sensor_setting = SensorSetting(SensorAngle=22.5, RotateAngle=45, SensorOffset=Slider(7, range=0..10))
brep = Brep(<brep referenced from the Rhino model>)
brep_2 = Brep(<brep referenced from the Rhino model>)
brep_environment = BrepEnvironment(XResolution=100, YResolution=100, ZResolution=100, Brep=brep, Obstacles=brep_2)  # -> Environment, Pts
escape_setting = EscapeSetting(EscapePossibility=Slider(0.8, range=0..1))
physarealm = Physarealm(
    Environment=brep_environment.Environment,
    Emitter=point_emitter,
    Food=points_food,
    Settings=[initial_population_setting, guide_setting, sensor_setting, speed_setting, birth_death_setting, trail_setting, death_distance_setting, detect_direction_setting, escape_setting],
    Reset=Toggle(False))  # -> ChemoAttractorField, Population, Iteration
timer = Timer(TimerInterval=200, Target=physarealm)  # disabled
population_position = PopulationPosition(Population=physarealm.Population)
panel = Panel(physarealm.Iteration)
panel_2 = Panel(physarealm.Population)
population_trail = PopulationTrail(Population=physarealm.Population, HistoryStep=10, Reset=Toggle(True))
polyline = PolyLine(Vertices=population_trail, Closed=False)
explode = Explode(Curve=polyline, Recursive=True)  # -> Segments, Vertices
list_length = ListLength(List=explode.Segments)
series = Series(Start=0, Step=1, Count=list_length)
bounds = Bounds(Numbers=flatten(series))
deconstruct_domain = DeconstructDomain(Domain=bounds)  # -> Start, End
gradient = Gradient(
    LowerLimit=deconstruct_domain.Start,
    UpperLimit=deconstruct_domain.End,
    Parameter=series,
    stops=[0: RGB(255, 255, 255), 1: RGB(0, 0, 0)])
custom_preview = CustomPreview(Geometry=explode.Segments, Shader=gradient)
